% Simulink data dictionary Quad.sldd

theta1 = Simulink.Parameter(45, Unit="deg")
theta2 = Simulink.Parameter(135, Unit="deg")
theta3 = Simulink.Parameter(225, Unit="deg")
theta4 = Simulink.Parameter(315, Unit="deg")
L_arm = Simulink.Parameter(0.225, Unit="m")
hub_dims = Simulink.Parameter([0.114 0.114 0.055], Unit="m")
m_hub = Simulink.Parameter(0.455, Unit="kg")
h_motor = Simulink.Parameter(0.03, Unit="m")
r_motor = Simulink.Parameter(0.014, Unit="m")
m_arm = Simulink.Parameter(0.05, Unit="kg")
arm_dims = Simulink.Parameter([0.22 0.04 0.02], Unit="m")
m_motor = Simulink.Parameter(0.057, Unit="kg")
m_prop = Simulink.Parameter(0.013, Unit="kg")
prop_dims = Simulink.Parameter([0.254 0.02 0.005], Unit="m")
r_arm_in = Simulink.Parameter(0.03, Unit="m")
z_cg = Simulink.Parameter(Simulink.data.Expression(ExpressionString="0.008321"), Unit="m")  % hight of com above the center, measured with inertia sensor
kT = Simulink.Parameter(1.031198e-05, Unit="N*s^2/rad^2")  % Thrust coeff, T = kT*Omega^2. Derived in derive_rotor_params.m
kQ = Simulink.Parameter(1.70879e-07, Unit="N*m*s^2/rad^2")  % Drag torque coeff, Q = kQ*Omega^2. ESTIMATE (FM assumed). derive_rotor_params.m
rotor_dir = Simulink.Parameter([-1 1 -1 1])  % Spin direction [FL RL RR FR], +1 = CCW from above (PX4 quad X)
Omega_h = Simulink.Parameter(471.482, Unit="rad/s")  % Hover speed per rotor, sqrt(m*g/(4*kT)). derive_rotor_params.m
tau_m = Simulink.Parameter(0.07, Unit="s")  % Motor time constant, measured (IJPEDS 2018). derive_rotor_params.m
Omega_max = Simulink.Parameter(1069.398, Unit="rad/s")  % Rotor speed limit = KV*V no-load. UPPER BOUND. derive_rotor_params.m

MotorCmdBus = Simulink.Bus()
  Omega_cmd: double[4], Unit="rad/s"  % commanded rotor speeds

StateBus = Simulink.Bus()
  p_W: double[3], Unit="m"  % pos of CoM in world (enu)
  v_W: double[3]
  eta: double[3]
  omega_B: double[3]